# Dynamo graph Attractor.dyn (Dynamo 0.7.4.3245)

integer_slider = IntegerSlider(11, range=1..20)
number = DoubleInput(1)
number_2 = DoubleInput(0)
number_3 = DoubleInput(1)
xyzGrid = Custom[XyzGrid](x_count=integer_slider, y_count=integer_slider, z_count=number, x0=number_2, y0=number_2, z0=number_2, x_space=number_3, y_space=number_3, z_space=number_3)  # This node represents an upgrade of the 0.6.3 XyzGrid node to 0.7.x
double_slider = DoubleSlider(5.956, range=0..10)
double_slider_2 = DoubleSlider(6.644664687, range=0..10)
number_4 = DoubleInput(0)
byCoordinates = Point.ByCoordinates(double_slider, double_slider_2, number_4)
byStartPointEndPoint = Line.ByStartPointEndPoint(xyzGrid, byCoordinates)
length = Vector.Length(byStartPointEndPoint)
double_slider_3 = DoubleSlider(12, range=1..100)
div = length / double_slider_3
byCenterPointRadius = Circle.ByCenterPointRadius(xyzGrid, div)
watch_3d = Watch3D(byCenterPointRadius)
