# Dynamo custom node DetailComponent.ByCurve in Active View.DYF (Dynamo 0.8.2.2392)
# category: BCJdt.Graphics
# Creates a Detail Componet in the Active View based on a given list of curves

Curves = Input()
Detail_Component = Input()
detailcomponent_bycurve_in = Python(IN[0]=Curves, IN[1]=Detail_Component)  # "DetailComponent.ByCurve in Active View"
# ---------- detailcomponent_bycurve_in.python (50 lines) ----------
# Copyright(c) 2015, Jon Szczesniak - @jonszcz
# BCJdt - Bohlin Cywinski Jackson designtech

import clr
clr.AddReference('ProtoGeometry')
from Autodesk.DesignScript.Geometry import *

# Import RevitAPI
clr.AddReference("RevitAPI")
import Autodesk
from Autodesk.Revit.DB import *

# Import DocumentManager and TransactionManager
clr.AddReference("RevitServices")
import RevitServices
from RevitServices.Persistence import DocumentManager
from RevitServices.Transactions import TransactionManager

# Import ToDSTType(bool) extension method
clr.AddReference("RevitNodes")
import Revit
clr.ImportExtensions(Revit.Elements)
clr.ImportExtensions(Revit.GeometryConversion)


# --- INPUTS ---
#The inputs to this node will be stored as a list in the IN variables.
#The location Curves will be stored in the IN[0] variable.
_locCurves = UnwrapElement(IN[0])

#The intended LineStyle Output will be stored in the IN[1] variable.
_detComponent = UnwrapElement(IN[1])

doc = DocumentManager.Instance.CurrentDBDocument
app = DocumentManager.Instance.CurrentUIApplication.Application

# --- OUTPUTS ---
outComponent = []
# --- BODY ---

#Transaction - Use when creating content in the Revit Model
TransactionManager.Instance.EnsureInTransaction(doc)
# Iterate through the location Curves and draw a Revit Detail line based on those Curves
for c in _locCurves:
	detComponent = doc.Create.NewFamilyInstance(c.ToRevitType(), _detComponent, doc.ActiveView)
	outComponent.append(detCurve)
TransactionManager.Instance.TransactionTaskDone()

#Assign your output to the OUT variable.
OUT = outComponent
# ----------------------------------------
Detail_Component_2 = Output(detailcomponent_bycurve_in)  # "Detail Component"
