# Dynamo custom node DetailLine w LineStyle.ByCurve in Active View.dyf (Dynamo 0.8.2.2392)
# category: BCJdt.Graphics
# Create Detail Line w LineStyle by a Curve in the Active Revit View

Curves = Input()
GraphicStyle = Input()
python_script = Python(IN[0]=Curves, IN[1]=GraphicStyle)
# ---------- python_script.python (51 lines) ----------
# Copyright(c) 2015, Jon Szczesniak - @jonszcz
# BCJdt - Bohlin Cywinski Jackson designtech

import clr
clr.AddReference('ProtoGeometry')
from Autodesk.DesignScript.Geometry import *

# Import RevitAPI
clr.AddReference("RevitAPI")
import Autodesk
from Autodesk.Revit.DB import *

# Import DocumentManager and TransactionManager
clr.AddReference("RevitServices")
import RevitServices
from RevitServices.Persistence import DocumentManager
from RevitServices.Transactions import TransactionManager

# Import ToDSTType(bool) extension method
clr.AddReference("RevitNodes")
import Revit
clr.ImportExtensions(Revit.Elements)
clr.ImportExtensions(Revit.GeometryConversion)


# --- INPUTS ---
#The inputs to this node will be stored as a list in the IN variables.
#The location Curves will be stored in the IN[0] variable.
_locCurves = UnwrapElement(IN[0])

#The intended LineStyle Output will be stored in the IN[1] variable.
_linestyle = UnwrapElement(IN[1])

doc = DocumentManager.Instance.CurrentDBDocument
app = DocumentManager.Instance.CurrentUIApplication.Application

# --- OUTPUTS ---
outCurve = []
# --- BODY ---

#Transaction - Use when creating content in the Revit Model
TransactionManager.Instance.EnsureInTransaction(doc)
# Iterate through the location Curves and draw a Revit Detail line based on those Curves
for c in _locCurves:
	detCurve = doc.Create.NewDetailCurve(doc.ActiveView, c.ToRevitType())
	detCurve.LineStyle = _linestyle
	outCurve.append(detCurve)
TransactionManager.Instance.TransactionTaskDone()

#Assign your output to the OUT variable.
OUT = outCurve
# ----------------------------------------
Detail_Lines = Output(python_script)
