# Dynamo custom node Get GraphicStyle by Name.DYF (Dynamo 0.8.2.2392)
# category: BCJdt.Graphics
# Returns the GraphicStyle of a Linestyle Name

LineStyle = Input()
get_linestyle_by_name = Python(IN[0]=LineStyle)
# ---------- get_linestyle_by_name.python (40 lines) ----------
# Copyright(c) 2015, Jon Szczesniak - @jonszcz
# BCJdt - Bohlin Cywinski Jackson designtech

import clr
clr.AddReference('ProtoGeometry')
from Autodesk.DesignScript.Geometry import *

# Import RevitAPI
clr.AddReference("RevitAPI")
import Autodesk
from Autodesk.Revit.DB import *

# Import DocumentManager and TransactionManager
clr.AddReference("RevitServices")
import RevitServices
from RevitServices.Persistence import DocumentManager
from RevitServices.Transactions import TransactionManager

# --- INPUTS ---
#The inputs to this node will be stored as a list in the IN variables.
#The input to this node will be stored in the IN[0] variable.
name = IN[0]

doc =  DocumentManager.Instance.CurrentDBDocument
app =  DocumentManager.Instance.CurrentUIApplication.Application

# ---OUTPUT---
lStyle = []

# ---BODY---
#collect all Lines in the model
lineStyles = FilteredElementCollector(doc).OfCategory(BuiltInCategory.OST_Lines)

try:
	lStyle.append(next(i.LineStyle for i in lineStyles if name==i.LineStyle.Name))
except StopIteration:
	pass

#Assign your output to the OUT variable.
OUT = lStyle[0]
# ----------------------------------------
GraphicStyle = Output(get_linestyle_by_name)
