# Dynamo custom node List LineStyle.DYF (Dynamo 0.8.2.2392)
# category: BCJdt.Graphics
# Returns a list of all LineStyles for Detail and Model lines

list_linestyles = Python()
# ---------- list_linestyles.python (37 lines) ----------
# Copyright(c) 2015, Jon Szczesniak - @jonszcz
# BCJdt - Bohlin Cywinski Jackson designtech

import clr
clr.AddReference('ProtoGeometry')
from Autodesk.DesignScript.Geometry import *

# Import RevitAPI
clr.AddReference("RevitAPI")
import Autodesk
from Autodesk.Revit.DB import *

# Import DocumentManager and TransactionManager
clr.AddReference("RevitServices")
import RevitServices
from RevitServices.Persistence import DocumentManager
from RevitServices.Transactions import TransactionManager

# ---INPUTS---
#The inputs to this node will be stored as a list in the IN variables.

doc =  DocumentManager.Instance.CurrentDBDocument
app =  DocumentManager.Instance.CurrentUIApplication.Application

# ---OUTPUTS---
lStyle = []

# ---BODY---
#collect all Lines in the model
lineStyles = FilteredElementCollector(doc).OfCategory(BuiltInCategory.OST_Lines)

for i in lineStyles:
	i = i.LineStyle.Name
	lStyle.append(i)

#Assign your output to the OUT variable.
OUT = sorted(set(lStyle))
# ----------------------------------------
LineStyles = Output(list_linestyles)
