# Dynamo custom node Filter Wall by Fire Rating & Level.DYF (Dynamo 0.8.2.2392)
# category: BCJdt.Life Safety
# Returns wall based on a given Level and Fire Rating

level = Input(level : Level)
name = Level.Name(level)
Fire_Rating = Input()
fire_rated_wall_collector = Python(IN[0]=name, IN[1]=Fire_Rating)
# ---------- fire_rated_wall_collector.python (81 lines) ----------
# Copyright(c) 2015, Jon Szczesniak - @jonszcz
# BCJdt - Bohlin Cywinski Jackson designtech

import clr
clr.AddReference('ProtoGeometry')
from Autodesk.DesignScript.Geometry import *

# Import RevitAPI
clr.AddReference("RevitAPI")
import Autodesk
from Autodesk.Revit.DB import *

# Import DocumentManager and TransactionManager
clr.AddReference("RevitServices")
import RevitServices
from RevitServices.Persistence import DocumentManager
from RevitServices.Transactions import TransactionManager

# Import ToDSTType(bool) extension method
clr.AddReference("RevitNodes")
import Revit
clr.ImportExtensions(Revit.Elements)


# --- INPUTS ---
#The inputs to this node will be stored as a list in the IN variables.
inputList = IN

#The inputs to this node will be stored in the IN[0] variable.
_level = UnwrapElement(IN[0])
_rating = IN[1]

doc = DocumentManager.Instance.CurrentDBDocument
app = DocumentManager.Instance.CurrentUIApplication.Application

# -- OUPUTS ---
allWallIDs = []
levels = []
levelWalls = []
wTypes = []
wRatings = []
rWalls = []
locs = []


# --- BODY ---
# Collect all * of the model into a list
collector = FilteredElementCollector(doc).OfCategory(BuiltInCategory.OST_Walls).OfClass(Wall)
famtype = collector.GetElementIdIterator()
famtype.Reset()

for x in famtype:
	# Return Wall IDs for all walls in the FilteredElementCollector
	allWallIDs.append(x)
	
	# Get the elements based on their element ID
	Walls = doc.GetElement(x)
	
	# Return the Base Constrint of each wall
	levname = Walls.Parameter['Base Constraint'].AsValueString()
	levels.append(levname)	
	
	# Compare the Base Constraint against the target Level from input, and return true conditions
	if levname == _level:
		levelWalls.append(Walls)

# Iterate through the levelWalls / Extract Wall Type then Fire Rating of that Wall Type
for z in levelWalls:
	wType = z.WallType
	wTypes.append(wType)
	wRating = wType.Parameter['Fire Rating'].AsString()
	wRatings.append(wRating)
	
# Compare fire rating of wall type vs target rating, if true, export out the location curve
	if wRating == _rating:
		loc = Revit.GeometryConversion.RevitToProtoCurve.ToProtoType( z.Location.Curve, True )
		locs.append(loc)
		rWalls.append(z)
	
#Assign your output to the OUT variable.
OUT = (allWallIDs, levels, levelWalls, wTypes, wRatings, rWalls, locs)
# ----------------------------------------
code_block = CodeBlock { 6; }
getItemAtIndex = List.GetItemAtIndex(list=fire_rated_wall_collector, index=code_block)
item = Output(getItemAtIndex)
