# Dynamo custom node Get Wall Ratings.DYF (Dynamo 0.8.2.2392)
# category: BCJdt.Life Safety
# Returns a list of all the Fire Ratings of walls in the project

get_wall_fire_ratings = Python()
# ---------- get_wall_fire_ratings.python (50 lines) ----------
# Copyright(c) 2015, Jon Szczesniak - @jonszcz
# BCJdt - Bohlin Cywinski Jackson designtech

import clr
clr.AddReference('ProtoGeometry')
from Autodesk.DesignScript.Geometry import *

# Import RevitAPI
clr.AddReference("RevitAPI")
import Autodesk
from Autodesk.Revit.DB import *

# Import DocumentManager and TransactionManager
clr.AddReference("RevitServices")
import RevitServices
from RevitServices.Persistence import DocumentManager
from RevitServices.Transactions import TransactionManager

# Import ToDSTType(bool) extension method
clr.AddReference("RevitNodes")
import Revit
clr.ImportExtensions(Revit.Elements)


# --- INPUTS ---
#The inputs to this node will be stored as a list in the IN variables.
inputList = IN

#The inputs to this node will be stored in the IN[0] variable.

doc = DocumentManager.Instance.CurrentDBDocument
app = DocumentManager.Instance.CurrentUIApplication.Application

# -- OUPUTS ---
wRatings = []

# --- BODY ---
# Collect all * of the model into a list
collector = FilteredElementCollector(doc).OfCategory(BuiltInCategory.OST_Walls).OfClass(Wall)
famtype = collector.GetElementIdIterator()
famtype.Reset()

for x in famtype:
	x = doc.GetElement(x)
	wType = x.WallType
	wRating = wType.Parameter['Fire Rating'].AsString()
	wRatings.append(wRating)
	
#Assign your output to the OUT variable.
OUT = set(wRatings)
# ----------------------------------------
Wall_Ratings = Output(get_wall_fire_ratings)
