# Dynamo graph Fire Rating w Dynamo.dyn (Dynamo 0.8.2.2392)

# group: Only works on the Family Type Level
element_types = ElementTypes("Wall")
all_elements_of_type = ElementsOfType(element_types)
code_block = CodeBlock { "Fire Rating"; "60"; }

# group: Select Elements of filtered Fire Ratings > Filter for Elements on a given level (Clockwork package)
type = Custom[Element.Type](Element_s=all_elements_of_type)  # Gets the family type of a given element (if applicable).
watch = Watch(all_elements_of_type)
levels = Levels("LEVEL 1")

# group (continued): Only works on the Family Type Level
getParameterValueByName = Element.GetParameterValueByName(element=type, parameterName=code_block.out0)
eq = getParameterValueByName == code_block.out1
filterByBoolMask = List.FilterByBoolMask(list=all_elements_of_type, mask=eq)

# group (continued): Select Elements of filtered Fire Ratings > Filter for Elements on a given level (Clockwork package)
# note: Gets All the Used Ratings in the Project, so we could iterate multiple times for different ratings.
uniqueItems = List.UniqueItems(getParameterValueByName)

# group: Select Elements of filtered Fire Ratings > Filter for Elements on a given level
code_block_2 = CodeBlock { "Base Constraint"; }
getParameterValueByName_2 = Element.GetParameterValueByName(element=filterByBoolMask.in, parameterName=code_block_2)
name = Parameter.Name(getParameterValueByName_2)
name_2 = Level.Name(levels)
eq_2 = name == name_2
filterByBoolMask_2 = List.FilterByBoolMask(list=filterByBoolMask.in, mask=eq_2)

# group (continued): Select Elements of filtered Fire Ratings > Filter for Elements on a given level (Clockwork package)
location = Custom[Element.Location](Element_s=filterByBoolMask_2.in)  # Returns the location of an element as an XYZ (or if it's line-based the start and end point of the line), along with some booleans to help filtering the results. Use this for some element types (e.g. walls or lines) that do not work with the built-in Get Family Instance Location node.

list_linestyle = Custom[List LineStyle]()  # Returns a list of all LineStyles for Detail and Model lines
code_block_3 = CodeBlock { 13; }
getItemAtIndex = List.GetItemAtIndex(list=list_linestyle, index=code_block_3)
get_graphicstyle_by_name = Custom[Get GraphicStyle by Name](LineStyle=getItemAtIndex)  # Returns the GraphicStyle of a Linestyle Name
detailline_w_linestyle_bycurve = Custom[DetailLine w LineStyle.ByCurve in Active View](Curves=location.Curves, GraphicStyle=get_graphicstyle_by_name)  # Create Detail Line w LineStyle by a Curve in the Active Revit View
selectInView = Custom[Element.SelectInView](Element_s=detailline_w_linestyle_bycurve)  # Select the input elements in active view
