# Dynamo graph Fire Rating w Python.dyn (Dynamo 0.8.2.2392)

get_wall_ratings = Custom[Get Wall Ratings]()  # Returns a list of all the Fire Ratings of walls in the project
list_linestyle = Custom[List LineStyle]()  # Returns a list of all LineStyles for Detail and Model lines
code_block = CodeBlock { "-Code - 1 HR"; }
get_graphicstyle_by_name = Custom[Get GraphicStyle by Name](LineStyle=code_block)  # Returns the GraphicStyle of a Linestyle Name
levels = Levels("LEVEL 1")
code_block_2 = CodeBlock { "1 HR"; "2 HR"; "3 HR"; "60"; }
filter_wall_by_fire_rating_level = Custom[Filter Wall by Fire Rating & Level](level=levels, Fire_Rating=code_block_2.out3)  # Returns wall based on a given Level and Fire Rating
family_types = FamilyTypes("01 00 00 Fire Tape:1 hour")
detailcomponent_bycurve_in = Custom[DetailComponent.ByCurve in Active View](Detail_Component=family_types)  # Creates a Detail Componet in the Active View based on a given list of curves
detailline_w_linestyle_bycurve = Custom[DetailLine w LineStyle.ByCurve in Active View]()  # Create Detail Line w LineStyle by a Curve in the Active Revit View
selectInView = Custom[Element.SelectInView]()  # Select the input elements in active view
