# Dynamo graph Detail Line from Curves.dyn (Dynamo 0.8.2.2392)

select_model_elements = DSModelElementsSelection()  # 4 picked in the model

# group: These are nodes from the Clockwork package HOOK UP THE Curves > Curve(s) AND WATCH IT WORK --- FAST!
activeViewFromCurrentDocument = Custom[Document.ActiveViewFromCurrentDocument]()  # Gets the active view of the current document
fromCurve = Custom[DetailCurve.FromCurve](View=activeViewFromCurrentDocument)  # Creates a detail line based on a given curve
location = Custom[Element.Location](Element_s=select_model_elements)  # Returns the location of an element as an XYZ (or if it's line-based the start and end point of the line), along with some booleans to help filtering the results. Use this for some element types (e.g. walls or lines) that do not work with the built-in Get Family Instance Location node.
