# Dynamo graph Fire Rating w Dynamo - All Dynamo Nodes.dyn (Dynamo 0.8.2.2392)

# group: Only works on the Family Type Level
element_types = ElementTypes("Wall")
all_elements_of_type = ElementsOfType(element_types)
code_block = CodeBlock { "Fire Rating"; "60"; }

type = Custom[Element.Type](Element_s=all_elements_of_type)  # Gets the family type of a given element (if applicable).

# group (continued): Only works on the Family Type Level
getParameterValueByName = Element.GetParameterValueByName(element=type, parameterName=code_block.out0)
eq = getParameterValueByName == code_block.out1
filterByBoolMask = List.FilterByBoolMask(list=all_elements_of_type, mask=eq)

# note: Gets All the Used Ratings in the Project, so we could iterate multiple times for different ratings.
uniqueItems = List.UniqueItems(getParameterValueByName)
watch = Watch(all_elements_of_type)
levels = Levels("LEVEL 1")

# group: Select Elements of filtered Fire Ratings > Filter for Elements on a given level
code_block_2 = CodeBlock { "Base Constraint"; }
getParameterValueByName_2 = Element.GetParameterValueByName(element=filterByBoolMask.in, parameterName=code_block_2)
name = Parameter.Name(getParameterValueByName_2)
name_2 = Level.Name(levels)
eq_2 = name == name_2
filterByBoolMask_2 = List.FilterByBoolMask(list=filterByBoolMask.in, mask=eq_2)

location = Custom[Element.Location](Element_s=filterByBoolMask_2.in)  # Returns the location of an element as an XYZ (or if it's line-based the start and end point of the line), along with some booleans to help filtering the results. Use this for some element types (e.g. walls or lines) that do not work with the built-in Get Family Instance Location node.
family_types = FamilyTypes("01 00 00 Fire Tape:1 hour")
activeViewFromCurrentDocument = Custom[Document.ActiveViewFromCurrentDocument]()  # Gets the active view of the current document
byCurve = Custom[DetailComponent.ByCurve](Curve_s=location.Curves, Family_Type=family_types, View=activeViewFromCurrentDocument)  # Places a line-based detail component in a given view
