# Dynamo graph Fire Rating w Dynamo - Custom Python node.dyn (Dynamo 0.8.2.2392)

# group: Filter for only walls on a given level
levels = Levels("LEVEL 1")
all_elements_at_level = ElementsAtLevel(levels)
watch = Watch(all_elements_at_level)
categories = Categories("Walls")
isOfCategory = Custom[Element.IsOfCategory](element_s=all_elements_at_level, Category=categories)  # Checks whether an element is of a specified category
filterByBoolMask = List.FilterByBoolMask(list=all_elements_at_level, mask=isOfCategory)

python_script = Python(IN[0]=filterByBoolMask.in)
# ---------- python_script.python (52 lines) ----------
import clr

# Import RevitAPI
clr.AddReference("RevitAPI")
import Autodesk
from Autodesk.Revit.DB import *

# Import DocumentManager and TransactionManager
clr.AddReference("RevitServices")
import RevitServices
from RevitServices.Persistence import DocumentManager
from RevitServices.Transactions import TransactionManager

# Import ToDSType(bool) extension method
clr.AddReference("RevitNodes")
import Revit
clr.ImportExtensions(Revit.Elements)

# Import ProtoGeometry
clr.AddReference('ProtoGeometry')
from Autodesk.DesignScript.Geometry import *

# Define doc and app
doc = DocumentManager.Instance.CurrentDBDocument
app = DocumentManager.Instance.CurrentUIApplication.Application

#The inputs to this node will be stored as a list in the IN variables.

dataEnteringNode = IN

types = []
ratings = []
walls = []
locs = []
output = []

for x in IN[0]:
	#type = x.GetType()
	type = x.GetParameterValueByName("Type")
	types.append(type)
	rating = type.GetParameterValueByName("Fire Rating")
	ratings.append(rating)
	inst = UnwrapElement(x)
	walls.append(inst)
	loc = Revit.GeometryConversion.RevitToProtoCurve.ToProtoType( inst.Location.Curve, True )
	locs.append(loc)

#output.append(walls)
#output.append(types)
#output.append(locs)
#output.append(ratings)
OUT = (walls, types, locs, ratings)
# ----------------------------------------
watch_2 = Watch(python_script)
code_block = CodeBlock { 0; 1; 2; 3; }
wall_elements = List.GetItemAtIndex(list=python_script, index=code_block.out0)
wall_types = List.GetItemAtIndex(list=python_script, index=code_block.out1)
fire_rating = List.GetItemAtIndex(list=python_script, index=code_block.out3)
# note: HOOK IT UP HERE
current = Document.Current()
activeView = Document.ActiveView(current)

# group: Node from Clockwork Package
fromCurve = Custom[DetailCurve.FromCurve](View=activeView)  # Creates a detail line based on a given curve

location_line = List.GetItemAtIndex(list=python_script, index=code_block.out2)
watch_3 = Watch(location_line)
