# Dynamo custom node Fire Ratings.dyf (Dynamo 0.8.1.1942)
# category: Revit.Elements.Wall

Wall_Ratings_s = Input()  # "Wall Ratings(s)"
turn_into_list = Custom[Turn Into List](item=Wall_Ratings_s)  # Turns an element (or a nested list) into a flat list
python_script = Python(IN[0]=turn_into_list)
# ---------- python_script.python (17 lines) ----------
import clr
clr.AddReference('RevitAPI')
from Autodesk.Revit.DB import *

clr.AddReference("RevitNodes")
import Revit
clr.ImportExtensions(Revit.Elements)

wallrating = UnwrapElement(IN[0])
ratinglist = list()

for item in wallrating:
	try:
		ratinglist.append(item.get_Parameter(BuiltInParameter.FUNCTION_PARAM).AsValueString())
	except:
		functionlist.append('No Wall/Function')
OUT = functionlist
# ----------------------------------------
returnListOrSingleValue = Custom[ReturnListOrSingleValue](item_1_unknown=Wall_Ratings_s, item_2_list=python_script)  # If the item in input #1 is not a list, only the first item of the list in input #2 will be returned.
Function_s = Output(returnListOrSingleValue)  # "Function(s)"
