# Dynamo graph FireRatingTape - Ben.dyn (Dynamo 0.8.2.2392)

# group: Only works on the Family Type Level
element_types = ElementTypes("Wall")
all_elements_of_type = ElementsOfType(element_types)
type = Custom[Element.Type](Element_s=all_elements_of_type)  # This retrieves the element type of the given elements. (if available) Similar to others available but no python here.
code_block = CodeBlock { "Fire Rating"; "60"; }
getParameterValueByName = Element.GetParameterValueByName(element=type, parameterName=code_block.out0)
eq = getParameterValueByName == code_block.out1
filterByBoolMask = List.FilterByBoolMask(list=all_elements_of_type, mask=eq)

# note: Gets All the Used Ratings in the Project, so we could iterate multiple times for different ratings.
uniqueItems = List.UniqueItems(getParameterValueByName)
levels = Levels("LEVEL 1")

# group: Select Elements of filtered Fire Ratings > Filter for Elements on a given level (Clockwork package)
code_block_2 = CodeBlock { "Base Constraint"; }
getParameterValueByName_2 = Element.GetParameterValueByName(element=filterByBoolMask.in, parameterName=code_block_2)
name = Parameter.Name(getParameterValueByName_2)
name_2 = Level.Name(levels)
eq_2 = name == name_2
filterByBoolMask_2 = List.FilterByBoolMask(list=filterByBoolMask.in, mask=eq_2)

location = Custom[Element.Location](Element_s=filterByBoolMask_2.in)  # Returns the location of an element as an XYZ (or if it's line-based the start and end point of the line), along with some booleans to help filtering the results. Use this for some element types (e.g. walls or lines) that do not work with the built-in Get Family Instance Location node.
current = Document.Current()
activeView = Document.ActiveView(current)
# note: HOOK UP
python_script = Python(IN[1]=activeView)
# ---------- python_script.python (24 lines) ----------
import clr
clr.AddReference('RevitAPI')
from Autodesk.Revit.DB import *

clr.AddReference("RevitNodes")
import Revit
clr.ImportExtensions(Revit.GeometryConversion)

clr.AddReference("RevitServices")
import RevitServices
from RevitServices.Persistence import DocumentManager
from RevitServices.Transactions import TransactionManager

doc = DocumentManager.Instance.CurrentDBDocument
curves = UnwrapElement(IN[0])
view = UnwrapElement(IN[1])
elementlist = []

TransactionManager.Instance.EnsureInTransaction(doc)
for curve in curves:
	detcurve = doc.Create.NewDetailCurve(view, curve.ToRevitType())
	elementlist.append(detcurve)
TransactionManager.Instance.TransactionTaskDone()
OUT = elementlist
# ----------------------------------------
