# Dynamo graph FireTape Detail Components.dyn (Dynamo 0.8.2.2392)

levels = Levels("LEVEL 1")

# group: Filter Walls per level
element_types = ElementTypes("Wall")
all_elements_of_type = ElementsOfType(element_types)
code_block = CodeBlock { "Base Constraint"; }
getParameterValueByName = Element.GetParameterValueByName(element=all_elements_of_type, parameterName=code_block)
name = Parameter.Name(getParameterValueByName)
name_2 = Level.Name(levels)
eq = name == name_2
filterByBoolMask = List.FilterByBoolMask(list=all_elements_of_type, mask=eq)
watch = Watch(all_elements_of_type)

code_block_2 = CodeBlock { "60"; }

# group: Filter Wall Ratings
type = Custom[Element.Type](Element_s=filterByBoolMask.in)  # Gets the family type of a given element (if applicable).
code_block_3 = CodeBlock { "Fire Rating"; }
# note: Gets All the Used Ratings in the Project, so we could iterate multiple times for different ratings.
getParameterValueByName_2 = Element.GetParameterValueByName(element=type, parameterName=code_block_3)
uniqueItems = List.UniqueItems(getParameterValueByName_2)
eq_2 = getParameterValueByName_2 == code_block_2
filterByBoolMask_2 = List.FilterByBoolMask(list=filterByBoolMask.in, mask=eq_2)

# note: Make sure to have the 10 00 00 Fire Tape.rfa loaded in the project from the S:\ drive
family_types = FamilyTypes("01 00 00 Fire Tape:1 hour")

# group: Link level selction to the associate floor plan of that level
get_all_views = Custom[Get All Views]()  # This node will query all views in the model and return them based on category
code_block_4 = CodeBlock { "View Name"; }
getParameterValueByName_3 = Element.GetParameterValueByName(element=get_all_views.Floor_Plans, parameterName=code_block_4)
name_3 = Level.Name(levels)
indexOf = IndexOf(getParameterValueByName_3, name_3)
getItemAtIndex = List.GetItemAtIndex(list=get_all_views.Floor_Plans, index=indexOf)
parameters = Element.Parameters(get_all_views.Floor_Plans)

# group: Create Detail Components based on Wall.location curve
location = Custom[Element.Location](Element_s=filterByBoolMask_2.in)  # Returns the location of an element as an XYZ (or if it's line-based the start and end point of the line), along with some booleans to help filtering the results. Use this for some element types (e.g. walls or lines) that do not work with the built-in Get Family Instance Location node.
byCurve = Custom[DetailComponent.ByCurve](Family_Type=family_types, View=getItemAtIndex)  # Places a line-based detail component in a given view
current = Document.Current()
activeView = Document.ActiveView(current)

code_block_5 = CodeBlock { "+ Pen 6"; }
python_script = Python(IN[0]=code_block_5)
# ---------- python_script.python (31 lines) ----------
import clr
clr.AddReference('ProtoGeometry')
from Autodesk.DesignScript.Geometry import *

# Import RevitAPI
clr.AddReference("RevitAPI")
import Autodesk
from Autodesk.Revit.DB import *
# Import DocumentManager and TransactionManager
clr.AddReference("RevitServices")
import RevitServices
from RevitServices.Persistence import DocumentManager
from RevitServices.Transactions import TransactionManager
#The inputs to this node will be stored as a list in the IN variables.
name = IN[0]

#The input to this node will be stored in the IN[0] variable.

doc =  DocumentManager.Instance.CurrentDBDocument
app =  DocumentManager.Instance.CurrentUIApplication.Application

#collect all Lines in the model
lineStyles = FilteredElementCollector(doc).OfCategory(BuiltInCategory.OST_Lines)
lStyle = []
try:
	lStyle.append(next(i.LineStyle for i in lineStyles if name==i.LineStyle.Name))
except StopIteration:
	pass

#Assign your output to the OUT variable.
OUT = lStyle[0]
# ----------------------------------------
python_script_2 = Python(IN[1]=getItemAtIndex, IN[2]=python_script)
# ---------- python_script_2.python (31 lines) ----------
import clr
clr.AddReference('RevitAPI')
from Autodesk.Revit.DB import *

clr.AddReference("RevitNodes")
import Revit
clr.ImportExtensions(Revit.GeometryConversion)

clr.AddReference("RevitServices")
import RevitServices
from RevitServices.Persistence import DocumentManager
from RevitServices.Transactions import TransactionManager

doc = DocumentManager.Instance.CurrentDBDocument
curves = UnwrapElement(IN[0])
view = UnwrapElement(IN[1])
_lineStyle = UnwrapElement(IN[2])
elementlist = []

TransactionManager.Instance.EnsureInTransaction(doc)
for curve in curves:
	detcurve = doc.Create.NewDetailCurve(view, curve.ToRevitType())
	#could also use doc.Create.NewDetailCurve(doc.ActiveView, curve)
	#detcurve = dir(detcurve.LineStyle)
	detcurve.LineStyle = _lineStyle
	#detcurve = dir(curve.ToRevitType.GraphicStyleId())
	#detcurve.LineStyle = _lineStyle
	elementlist.append(detcurve)
TransactionManager.Instance.TransactionTaskDone()

OUT = elementlist
# ----------------------------------------
watch_2 = Watch(python_script_2)
select_model_element = DSModelElementSelection()  # 1 picked in the model
python_script_3 = Python(IN[0]=select_model_element)
# ---------- python_script_3.python (10 lines) ----------
import clr
clr.AddReference('ProtoGeometry')
from Autodesk.DesignScript.Geometry import *
#The inputs to this node will be stored as a list in the IN variables.
dtline = UnwrapElement(IN[0])

linestyle = dtline.LineStyle

#Assign your output to the OUT variable.
OUT = linestyle
# ----------------------------------------
watch_3 = Watch(python_script_3)
python_script_4 = Python()  # starter script, not edited (OUT = 0)
lunchbox_wall_element_collector = Custom[LunchBox Wall Element Collector]()  # Collects wall elements from the Revit document.
