# Dynamo graph Rated Walls 2.dyn (Dynamo 0.8.1.1942)

python_script = Python()
# ---------- python_script.python (34 lines) ----------
import clr
clr.AddReference('RevitAPI')
import Autodesk
from Autodesk.Revit.DB import *
clr.AddReference('RevitServices')
import RevitServices
from RevitServices.Persistence import DocumentManager

doc = DocumentManager.Instance.CurrentDBDocument
app = DocumentManager.Instance.CurrentUIApplication.Application

collector = FilteredElementCollector(doc)
collector.OfCategory(BuiltInCategory.OST_Walls)
collector.OfClass(Wall)
walls = collector.GetElementIdIterator()
walls.Reset()

output = []
heights = []
FireRating = []

for x in walls:
	wallinst = doc.GetElement(x)
	height = wallinst.Parameter['Unconnected Height'].AsValueString()
	FR = type(BuiltInParameter.FIRE_RATING)
	
	heights.append(height)
	FireRating.append(FR)
	
#Assign your output to the OUT variable.
output.append(heights)
output.append(FireRating)

OUT = output
# ----------------------------------------
watch = Watch(python_script)
