# Dynamo graph Rated Walls.dyn (Dynamo 0.8.1.1942)

boolean = BoolSelector(false)
code_block = CodeBlock { "*"; }
lunchbox_wall_element_collector = Custom[LunchBox Wall Element Collector](Toggle=boolean, Wall_Type=code_block)  # Collects wall elements from the Revit document.
watch = Watch(lunchbox_wall_element_collector.ElementID)
boolean_2 = BoolSelector(true)
wall_fire_ratings = Custom[Wall Fire Ratings](Toggle=boolean_2, Wall_Type=code_block)  # Collects Fire Ratings of walls
watch_2 = Watch(wall_fire_ratings)
