# Dynamo graph Floor follow Toposurface.dyn (Dynamo 0.9.0.3067)

# note: 1. Create a Floor with the exact outline as the hardscape you want to create.
# 2. Edit the floor sketch and copy the outline of the floor.
# 3. Create a Subregion in the toposurface and Paste-in-Place the sketch lines from the floor.
# 4. Select the SubRegion in the top box of the workflow.
# 5. Select the Floor in the bottom box of the workflow.
# note: Make a floor element follow a toposurface - Useful to create hardscapes.
# USE IN MANUAL MODE
# DEPENDENCIES
# Clockwork
# jon szczesniak - 2015 12 17
select_topo_subregion = DSModelElementSelection()
points = Topography.Points(select_topo_subregion)
select_floor_slab = DSModelElementSelection()

# group: CLOCKWORK Package
slabShapeByPoints = Custom[RoofOrFloor.SlabShapeByPoints](Point_s=points, Floor_Roof=select_floor_slab)  # Transform a slab shape based on a list of XYZs. PLEASE NOTE: Will reset any previous edits on the slab shape.
