# Dynamo graph Image Sampling to Z amplitude.dyn (Dynamo 0.7.2.2114)

num_sampling_points = IntegerSlider(15, range=1..100)
integer_slider = IntegerSlider(1, range=1..2)
integer_slider_2 = IntegerSlider(0, range=0..100)
integer_slider_3 = IntegerSlider(1, range=1..5)
xyzGrid = Custom[XyzGrid](x_count=num_sampling_points, y_count=num_sampling_points, z_count=integer_slider, x0=integer_slider_2, y0=integer_slider_2, z0=integer_slider_2, x_space=integer_slider_3, y_space=integer_slider_3, z_space=integer_slider_3)  # This node represents an upgrade of the 0.6.3 XyzGrid node to 0.7.x
X = Point.X(xyzGrid)
Y = Point.Y(xyzGrid)
z_axis_amplitude = DoubleSlider(1.5, range=1..10)
file_path = Filename("C:\Users\jszczesniak\Desktop\Grey-Abstract.jpg")
readImage = File.ReadImage(file_path, num_sampling_points, num_sampling_points)
brightness = Color.Brightness(readImage)
mul = z_axis_amplitude * brightness
byCoordinates = Point.ByCoordinates(X, Y, mul)
loadImageFromPath = File.LoadImageFromPath(file_path)
watch_image = WatchImageCore(loadImageFromPath)
