# Dynamo graph Image Sampling by Brightness Tolerance.dyn (Dynamo 0.7.2.2114)

file_path = Filename("C:\Users\jszczesniak\Desktop\test.jpg")
loadImageFromPath = File.LoadImageFromPath(file_path)
watch_image = WatchImageCore(loadImageFromPath)
integer_slider = IntegerSlider(100, range=0..100)
number = DoubleInput(1)
number_2 = DoubleInput(0)
number_3 = DoubleInput(1)
xyzGrid = Custom[XyzGrid](x_count=integer_slider, y_count=integer_slider, z_count=number, x0=number_2, y0=number_2, z0=number_2, x_space=number_3, y_space=number_3, z_space=number_3)  # This node represents an upgrade of the 0.6.3 XyzGrid node to 0.7.x
readImage = File.ReadImage(file_path, integer_slider, integer_slider)
brightness = Color.Brightness(readImage)
double_slider = DoubleSlider(0.566, range=0..1)
black_on_white = brightness < double_slider
number_4 = DoubleInput(0.25)
number_5 = DoubleInput(0)
if_ = If(black_on_white, number_4, number_5)
byCenterPointRadius = Circle.ByCenterPointRadius(xyzGrid, if_)
code_block = CodeBlock { 0; 1; }
lt = code_block.out0 < code_block.out1
byCoordinates = Point.ByCoordinates()
code_block_2 = CodeBlock { 0; 0; 1; }
byCoordinates_2 = Point.ByCoordinates(code_block_2.out0, code_block_2.out1)
byCenterPointRadius_2 = Circle.ByCenterPointRadius(byCoordinates_2, code_block_2.out2)
if_2 = If(lt, byCoordinates, byCenterPointRadius_2)
white_on_black = brightness > double_slider
