# Dynamo graph Isovist - 3D.dyn (Dynamo 0.9.1.3872)

# group: Generate Bounding Geometry
origin = Point.Origin()
code_block = CodeBlock(Point=origin) { Circle.ByCenterPointRadius(Point,100).ParameterSplit(0.5); 40; }
levels = Levels("LEVEL 1")
wall_types = WallTypes("+GEN-Generic_12\"")
byCurveAndHeight = Wall.ByCurveAndHeight(curve=code_block.out0, height=code_block.out1, level=levels, wallType=wall_types)
geometry = Element.Geometry(byCurveAndHeight)

number_slider = DoubleSlider(0, range=-100..100 step 0.1)
number_slider_2 = DoubleSlider(-67.9, range=-100..100 step 0.1)
number_slider_3 = DoubleSlider(31.2, range=0..40 step 0.1)
byCoordinates = Point.ByCoordinates(x=number_slider, y=number_slider_2, z=number_slider_3)
byOrigin = CoordinateSystem.ByOrigin(byCoordinates)
code_block_2 = CodeBlock { 30; 50; }
code_block_3 = CodeBlock(u=code_block_2.out0, v=code_block_2.out1) { u1 = 360/u; v1 = 360/v; 0..360-u1..u1; 0..180-v1..v1; 100; }
bySphericalCoordinates = Point.BySphericalCoordinates(byOrigin, code_block_3.out2, code_block_3.out3, code_block_3.out4, lacing=CrossProduct)
flatten = Flatten(bySphericalCoordinates)
pruneDuplicates = Point.PruneDuplicates(points=flatten)
byTwoPoints = Vector.ByTwoPoints(start=byCoordinates, end=pruneDuplicates)
code_block_4 = CodeBlock { 1; }
views = Views("{3D}")
byOriginDirection = Revit.References.RayBounce.ByOriginDirection(byCoordinates, byTwoPoints, code_block_4, views)
isEmpty = List.IsEmpty()
map = List.Map(list=byOriginDirection.out1, f_x=isEmpty)
filterByBoolMask = List.FilterByBoolMask(list=byOriginDirection.out0, mask=map)
code_block_5 = CodeBlock { 1; }
getItemAtIndex = List.GetItemAtIndex(index=code_block_5)
map_2 = List.Map(list=filterByBoolMask.out, f_x=getItemAtIndex)
byStartPointEndPoint = Line.ByStartPointEndPoint(startPoint=byCoordinates, endPoint=map_2)
watch = Watch(map_2)
