# Dynamo graph Iterate and Save.dyn (Dynamo 0.9.0.3067)

code_block = CodeBlock { 10..50..10; }
select_model_element = DSModelElementSelection()  # 1 picked in the model
code_block_2 = CodeBlock { "Radius"; }
file_path = Filename("C:\Users\jszczesniak\Desktop\Design Tech Projects\Dynamo\Test")
updateparam_saveimage = Custom[UpdateParam&SaveImage](FamInstance=select_model_element, Param=code_block_2, SaveLocation=file_path)  # Updates a family parameter, then saves and image of the state of the model
map = List.Map(list=code_block, f_x=updateparam_saveimage)
