# Dynamo custom node UpdateParam&SaveImage.dyf (Dynamo 0.9.0.3067)
# category: BCJdt
# Updates a family parameter, then saves and image of the state of the model

FamInstance = Input()
Param = Input()
Value = Input()
setParameterByName = Element.SetParameterByName(element=FamInstance, parameterName=Param, value=Value)
end = Revit.Transaction.Transaction.End(setParameterByName)
current = Document.Current()
activeView = Document.ActiveView(current)
SaveLocation = Input()
string_from_object = FromObject(Value)
concat = String.Concat(SaveLocation, string_from_object)
exportAsImage = View.ExportAsImage(activeView, concat)
end_2 = Revit.Transaction.Transaction.End(exportAsImage)
compose = ComposeFunctions(end, end_2)  # "Function.Compose"
start = Revit.Transaction.Transaction.Start(compose)
Output = Output(start)  # ""
