# Dynamo graph list of lists.dyn (Dynamo 0.8.2.2392)

code_block = CodeBlock { 0..25..1; }
x = CodeBlock { 3; }
cycle = List.Cycle(list=code_block, amount=x)
count = List.Count(code_block)
chop = List.Chop(cycle, count)
watch = Watch(chop)
