# Dynamo graph Buildings from OSM.dyn (Dynamo 0.9.0.3067)

features = Elk.OSM.Features()
file_path = Filename("C:\Users\jszczesniak\Desktop\Carnegie Mellon University 160121.osm")
location = Elk.OSM.Location(file_path)
code_block = CodeBlock { "building"; "*"; }
OSMData = Elk.OSM.OSMData(location.out0, location.out1, code_block.out0, code_block.out1)
code_block_2 = CodeBlock { "ele:"; true; }
startsWith = String.StartsWith(searchFor=code_block_2.out0, ignoreCase=code_block_2.out1)
base_elevation_data = Map(list=OSMData.out1, f_x=startsWith)
code_block_3 = CodeBlock { "building:levels"; true; }
startsWith_2 = String.StartsWith(searchFor=code_block_3.out0, ignoreCase=code_block_3.out1)
numlevels_data = Map(list=OSMData.out1, f_x=startsWith_2)
code_block_4 = CodeBlock(a=numlevels_data) { a[71]; }
code_block_5 = CodeBlock { 1; }
flatten = List.Flatten(list=OSMData.out0, amt=code_block_5)
byPoints = Polygon.ByPoints(flatten)
removeNulls = Lists.Manage.RemoveNulls(byPoints)
ZAxis = Vector.ZAxis()
integer_slider = IntegerSlider(15, range=10..15 step 1)
extrudeAsSolid = Curve.ExtrudeAsSolid(curve=removeNulls, direction=ZAxis, distance=integer_slider)
translate = Geometry.Translate()
