# Dynamo graph Program XLS to 3d.dyn (Dynamo 0.9.0.3067)

# group: 01_PARSE spreadsheet
file_path = Filename("C:\Users\jszczesniak\Desktop\Design Tech Projects\Dynamo\Program Stacking and Blocking\Sample Program.xlsx")
fromPath = FileObject(file_path)  # "File.FromPath"
code_block = CodeBlock { "Sheet1"; }
readFromFile = Excel.ReadFromFile(file=fromPath, sheetName=code_block)
restOfItems = List.RestOfItems(readFromFile)
transpose = List.Transpose(restOfItems)
code_block_2 = CodeBlock(a=transpose) { a[0]; a[1]; a[2]; a[3]; a[4]; a[5]; a[6]; a[7]; a[8]; a[9]; a[10]; }
code_block_3 = CodeBlock(TotalArea=code_block_2.out5) { TotalArea; }
code_block_4 = CodeBlock(ProgramArea=code_block_2.out3) { ProgramArea; }
code_block_5 = CodeBlock(Quantity=code_block_2.out4) { Quantity; }
code_block_6 = CodeBlock(ProgramHeight=code_block_2.out6) { ProgramHeight; }
code_block_7 = CodeBlock(Department=code_block_2.out2) { Department; }
code_block_8 = CodeBlock(ProgramNotes=code_block_2.out10) { ProgramNotes; }
code_block_9 = CodeBlock(SpaceType=code_block_2.out1) { SpaceType; }
code_block_10 = CodeBlock(RoomName=code_block_2.out0) { RoomName; }
code_block_11 = CodeBlock(ProgramWidth=code_block_2.out8) { ProgramWidth; }
code_block_12 = CodeBlock(ProgramLength=code_block_2.out7) { ProgramLength; }
code_block_13 = CodeBlock(ProgramColor=code_block_2.out9) { ProgramColor; }

watch = Watch()

# group: 02_PARSE Replicating the PROGRAM AREA of individual program entries by quantity, then matching DEPARTMENT heirarchy sorting
ofRepeatedItem = List.OfRepeatedItem()
combine = List.Combine(ofRepeatedItem, code_block_4, code_block_5)
flatten = Flatten(combine)

# group: 02_PARSE Replicating the WIDTHS of individual program entries by quantity, then matching DEPARTMENT heirarchy sorting
ofRepeatedItem_2 = List.OfRepeatedItem()
combine_2 = List.Combine(ofRepeatedItem_2, code_block_6, code_block_5)
flatten_2 = Flatten(combine_2)

# group: 02_PARSE Replicating the DEPARTMENTS of individual program entries by quantity, assigning a unique ID, then creating sublists by DEPARTMENT type;
code_block_14 = CodeBlock { 0; }
ofRepeatedItem_3 = List.OfRepeatedItem()
combine_3 = List.Combine(ofRepeatedItem_3, code_block_7, code_block_5)
flatten_3 = Flatten(combine_3)
countOccurences = Custom[List.CountOccurences](list=flatten_3)  # Counts the number of occurences of each unique element in a given list
# note: Partials determines the Department sorting (sublist length)
lunchbox_mass_addition = Custom[LunchBox Mass Addition](Numbers=countOccurences.Count)  # Returns the total value of a list of numbers.
addItemToFront = List.AddItemToFront(item=code_block_14, list=lunchbox_mass_addition.Partials)
code_block_15 = CodeBlock(x=lunchbox_mass_addition.Partials) { x-1; }
code_block_16 = CodeBlock(x=addItemToFront, y=code_block_15) { x..y; }

getItemAtIndex = List.GetItemAtIndex(list=flatten_2, index=code_block_16)
code_block_17 = CodeBlock(ProgramWidth=getItemAtIndex) { ProgramWidth; }
removeNulls = Lists.Manage.RemoveNulls(code_block_17)
dropLast = Custom[List.DropLast](list=removeNulls)  # Removes the last value of the list.
code_block_18 = CodeBlock(a=dropLast) { a/2; }
code_block_19 = CodeBlock { 1; }
shiftIndices = List.ShiftIndices(amount=code_block_19)
map = List.Map(list=code_block_18, f_x=shiftIndices)
code_block_20 = CodeBlock(x=map) { x; }
code_block_21 = CodeBlock { 0; }
replaceItemAtIndex = List.ReplaceItemAtIndex(index=code_block_21, item=code_block_21)
map_2 = List.Map(list=code_block_20, f_x=replaceItemAtIndex)
integer_slider = IntegerSlider(50, range=0..100 step 1)
count = List.Count()
map_3 = List.Map(list=dropLast, f_x=count)
code_block_22 = CodeBlock(n=map_3) { n-1; }
ofRepeatedItem_4 = List.OfRepeatedItem(item=integer_slider, amount=code_block_22)
code_block_23 = CodeBlock { 0; }
insert = Insert(arg1=code_block_23, arg2=code_block_23)
map_4 = List.Map(list=ofRepeatedItem_4, f_x=insert)
code_block_24 = CodeBlock(a=code_block_18, b=map_2, c=map_4) { {a,b,c}; }
transpose_2 = List.Transpose(code_block_24)
transpose_3 = List.Transpose()
map_5 = List.Map(list=transpose_2, f_x=transpose_3)
sum = Math.Sum(map_5)
lunchbox_mass_addition_2 = Custom[LunchBox Mass Addition]()
map_6 = List.Map(list=sum, f_x=lunchbox_mass_addition_2.Partials)
flatten_4 = Flatten(map_6)

# group: 02_PARSE Replicating the PROGRAM NOTES of individual program entries by quantity, then matching DEPARTMENT heirarchy sorting
ofRepeatedItem_5 = List.OfRepeatedItem()
combine_4 = List.Combine(ofRepeatedItem_5, code_block_8, code_block_5)
flatten_5 = Flatten(combine_4)

getItemAtIndex_2 = List.GetItemAtIndex(list=flatten_5, index=code_block_16)
code_block_25 = CodeBlock(ProgramNotes=getItemAtIndex_2) { ProgramNotes; }

# group: 02_PARSE Replicating the SPACE TYPE of individual program entries by quantity, then matching DEPARTMENT heirarchy sorting
ofRepeatedItem_6 = List.OfRepeatedItem()
combine_5 = List.Combine(ofRepeatedItem_6, code_block_9, code_block_5)
flatten_6 = Flatten(combine_5)

getItemAtIndex_3 = List.GetItemAtIndex(list=flatten_6, index=code_block_16)
code_block_26 = CodeBlock(ProgramSpaceType=getItemAtIndex_3) { ProgramSpaceType; }

# group: 02_PARSE Replicating the ROOM NAMES of individual program entries by quantity, then matching DEPARTMENT heirarchy sorting
ofRepeatedItem_7 = List.OfRepeatedItem()
combine_6 = List.Combine(ofRepeatedItem_7, code_block_10, code_block_5)
flatten_7 = Flatten(combine_6)

getItemAtIndex_4 = List.GetItemAtIndex(list=flatten_7, index=code_block_16)
code_block_27 = CodeBlock(ProgramRoomName=getItemAtIndex_4) { ProgramRoomName; }
family_types = FamilyTypes("00 Programming Block:00 Programming Block")
boolean = BoolSelector(true)
add = Point.Add()
byCoordinates = Point.ByCoordinates(x=map_6)

# group: 02_PARSE Replicating the LENGTHS of individual program entries by quantity, then matching DEPARTMENT heirarchy sorting
ofRepeatedItem_8 = List.OfRepeatedItem()
combine_7 = List.Combine(ofRepeatedItem_8, code_block_11, code_block_12)
flatten_8 = Flatten(combine_7)

getItemAtIndex_5 = List.GetItemAtIndex(list=flatten_8, index=code_block_16)
code_block_28 = CodeBlock(ProgramLength=getItemAtIndex_5) { ProgramLength; }
maximumItem = List.MaximumItem(code_block_28)
code_block_29 = CodeBlock(a=maximumItem) { a/2; }
flatten_9 = Flatten(code_block_29)
code_block_30 = CodeBlock { 1; }
shiftIndices_2 = List.ShiftIndices(list=flatten_9, amount=code_block_30)
code_block_31 = CodeBlock { 0; }
replaceItemAtIndex_2 = List.ReplaceItemAtIndex(list=shiftIndices_2, index=code_block_31, item=code_block_31)
count_2 = List.Count(maximumItem)
code_block_32 = CodeBlock(n=count_2) { n-1; }
ofRepeatedItem_9 = List.OfRepeatedItem(item=integer_slider, amount=code_block_32)
code_block_33 = CodeBlock { 0; }
insert_2 = Insert(ofRepeatedItem_9, code_block_33, code_block_33)
code_block_34 = CodeBlock(a=flatten_9, b=replaceItemAtIndex_2, c=insert_2) { {a,b,c}; }
transpose_4 = List.Transpose(code_block_34)
transpose_5 = List.Transpose()
map_7 = List.Map(list=transpose_4, f_x=transpose_5)
sum_2 = Math.Sum(map_7)
lunchbox_mass_addition_3 = Custom[LunchBox Mass Addition](Numbers=sum_2)
byCoordinates_2 = Vector.ByCoordinates(y=lunchbox_mass_addition_3.Partials)
combine_8 = List.Combine(add, byCoordinates, byCoordinates_2)
code_block_35 = CodeBlock { null; }
if_ = If(test=boolean, true=combine_8, false=code_block_35)
levels = Levels("LEVEL 1")
byPointAndLevel = FamilyInstance.ByPointAndLevel(familyType=family_types, point=if_, level=levels)
code_block_36 = CodeBlock { "Height"; "Length"; "Width"; }

# group: 02_PARSE Replicating the HEIGHTS of individual program entries by quantity, then matching DEPARTMENT heirarchy sorting
ofRepeatedItem_10 = List.OfRepeatedItem()
combine_9 = List.Combine(ofRepeatedItem_10, code_block_11, code_block_5)
flatten_10 = Flatten(combine_9)

getItemAtIndex_6 = List.GetItemAtIndex(list=flatten_10, index=code_block_16)
code_block_37 = CodeBlock(ProgramHeight=getItemAtIndex_6) { ProgramHeight; }
setParameterByName = Element.SetParameterByName(element=byPointAndLevel, parameterName=code_block_36.out0, value=code_block_37)
code_block_38 = CodeBlock(ProgramWidth=getItemAtIndex) { ProgramWidth; }
setParameterByName_2 = Element.SetParameterByName(element=byPointAndLevel, parameterName=code_block_36.out2, value=code_block_38)
code_block_39 = CodeBlock(ProgramLength=getItemAtIndex_5) { ProgramLength; }
setParameterByName_3 = Element.SetParameterByName(element=byPointAndLevel, parameterName=code_block_36.out1, value=code_block_39)
flatten_11 = Flatten(byPointAndLevel)
dropLast_2 = Custom[List.DropLast](list=flatten_11)
code_block_40 = CodeBlock { "Program Color"; }

# group: 02_PARSE Replicating the PROGRAM COLOR of individual program entries by quantity, then matching DEPARTMENT heirarchy sorting
ofRepeatedItem_11 = List.OfRepeatedItem()
combine_10 = List.Combine(ofRepeatedItem_11, code_block_13, code_block_12)
flatten_12 = Flatten(combine_10)

getItemAtIndex_7 = List.GetItemAtIndex(list=flatten_12, index=code_block_16)
code_block_41 = CodeBlock(ProgramColor=getItemAtIndex_7) { ProgramColor; }
code_block_42 = CodeBlock { "Yellow"; "Orange"; "Purple"; "Blue"; "Gray"; }
create = List.Create(code_block_42.out0, code_block_42.out1, code_block_42.out2, code_block_42.out3, code_block_42.out4)
code_block_43 = CodeBlock()
# ---------- code_block_43.designscript (6 lines) ----------
Yellow="+00 Programming - Orange 01";
Orange="+00 Programming - Orange 02";
Purple="+00 Programming - Blue 01";
Blue="+00 Programming - Blue 03";
Gray="+00 Programming - Gray 03";
colors={Yellow,Orange,Purple,Blue,Gray};
# ----------------------------------------
matchWithKeyValues = Custom[List.MatchWithKeyValues](list=code_block_41, keys=create, values=code_block_43.colors)  # Matches a list with a given set of keys and returns the values corresponding to the keys
byName = Material.ByName(matchWithKeyValues)
setParameterByName_4 = Element.SetParameterByName(element=dropLast_2, parameterName=code_block_40, value=byName)
start = Revit.Transaction.Transaction.Start()
