# Dynamo graph Program XLS to 3d.dyn (Dynamo 0.9.0.3067)

# group: 00_EXCEL INPUT
# note: CHANGE FILE PATH TO PROGRAMMING .XLS FILE
file_path = Filename("C:\Users\jszczesniak\Desktop\Design Tech Projects\Dynamo\Program Stacking and Blocking\Sample Program.xlsx")
fromPath = FileObject(file_path)  # "File.FromPath"
code_block = CodeBlock { "Sheet1"; }
# note: read excel file, pull from sheet in string
readFromFile = Excel.ReadFromFile(file=fromPath, sheetName=code_block)
# note: exclude first row (header) information
restOfItems = List.RestOfItems(readFromFile)

# group: 01_SORTING: This sequence of nodes extract the values from the WIDTH column in the Excel File
# note: flips data to be grouped by column, not row
transpose = List.Transpose(restOfItems)
code_block_2 = CodeBlock { 8; }
# note: select only items in index 8 (WIDTH column)
getItemAtIndex = List.GetItemAtIndex(list=transpose, index=code_block_2)

# group: Multiplying instances of WIDTH by the QUANTITY column from spreadsheet
ofRepeatedItem = List.OfRepeatedItem()
# note: flips data to be grouped by column, not row
transpose_2 = List.Transpose(restOfItems)
# note: select only items in index 4 (QUANTITY column)
code_block_3 = CodeBlock { 4; }
getItemAtIndex_2 = List.GetItemAtIndex(list=transpose_2, index=code_block_3)
# note: multiplies each WIDTH by the associated value in the QUANTITY column from the excel file
combine = List.Combine(ofRepeatedItem, getItemAtIndex, getItemAtIndex_2)
# note: consolidates all sublist groups into one seamless list
flatten = Flatten(combine)

# group: 01_SORTING: This sequence of nodes creates a new list of sequential unique index numbers to later be paired with all DEPARTMENT values from the spreadsheet
# note: Adds 0 to the front of the list so every count starts at 0
code_block_4 = CodeBlock { 0; }
# note: flips data to be grouped by column, not row
transpose_3 = List.Transpose(restOfItems)
code_block_5 = CodeBlock { 2; }
# note: select only item in index[1] (DEPARTMENT) column
getItemAtIndex_3 = List.GetItemAtIndex(list=transpose_3, index=code_block_5)

# group: Accounting for QUANTITY column from spreadsheet
ofRepeatedItem_2 = List.OfRepeatedItem()
# note: flips data to be grouped by column, not row
transpose_4 = List.Transpose(restOfItems)
# note: select only item in index[3] (QUANTITY) column
code_block_6 = CodeBlock { 4; }
getItemAtIndex_4 = List.GetItemAtIndex(list=transpose_4, index=code_block_6)
# note: multiplies each Department by the associated value in the QUANTITY column from the excel file
combine_2 = List.Combine(ofRepeatedItem_2, getItemAtIndex_3, getItemAtIndex_4)
# note: consolidates all sublist groups into one seamless list
flatten_2 = Flatten(combine_2)

# group (continued): 01_SORTING: This sequence of nodes creates a new list of sequential unique index numbers to later be paired with all DEPARTMENT values from the spreadsheet
# note: Counts number of times each unique item (DEPARTMENT) occurs.
# Output:
# 1. List of unique items.
# 2. # of occurances
countOccurences = Custom[List.CountOccurences](list=flatten_2)  # Counts the number of occurences of each unique element in a given list
# note: RECURSIVE FUNCTION
# adds each item in the list to the sum of the values before it until the list is exhausted.
# (may need to modify Python within this node)
python_script = Python(IN[0]=countOccurences.Count)
# ---------- python_script.python (13 lines) ----------
import clr
clr.AddReference('ProtoGeometry')
from Autodesk.DesignScript.Geometry import *

#The inputs to this node will be stored as a list in the IN variables.
list = IN[0]
sum = 0

for i in range(0,len(list)):
	sum+=list[i]

#Assign your output to the OUT variable.
OUT = sum
# ----------------------------------------
addItemToFront = List.AddItemToFront(item=code_block_4, list=python_script)
# note: Since 0 is added to the front of the list above, we need to reduce the list by 1 to maintain the actual number of indices in the list.
code_block_7 = CodeBlock(x=python_script) { x-1; }
# note: Assigns a unique number to each DEPARTMENT occurence
code_block_8 = CodeBlock(x=addItemToFront, y=code_block_7) { x..y; }

getItemAtIndex_5 = List.GetItemAtIndex(list=flatten, index=code_block_8)

# group: 01_SORTING: This sequence of nodes extract the values from the LENGTH column in the Excel File
# note: flips data to be grouped by column, not row
transpose_5 = List.Transpose(restOfItems)
code_block_9 = CodeBlock { 7; }
# note: select only items in index 7 (LENGTH column)
getItemAtIndex_6 = List.GetItemAtIndex(list=transpose_5, index=code_block_9)

# group: Multiplying instances of LENGTH by the QUANTITY column from spreadsheet
ofRepeatedItem_3 = List.OfRepeatedItem()
# note: flips data to be grouped by column, not row
transpose_6 = List.Transpose(restOfItems)
# note: select only items in index 4 (QUANTITY column)
code_block_10 = CodeBlock { 4; }
getItemAtIndex_7 = List.GetItemAtIndex(list=transpose_6, index=code_block_10)
# note: multiplies each LENGTH by the associated value in the QUANTITY column from the excel file
combine_3 = List.Combine(ofRepeatedItem_3, getItemAtIndex_6, getItemAtIndex_7)
# note: consolidates all sublist groups into one seamless list
flatten_3 = Flatten(combine_3)

getItemAtIndex_8 = List.GetItemAtIndex(list=flatten_3, index=code_block_8)

# group: 02_SPACING: Using recursive function to evenly space centroid coordinates based on program widths from spreadsheet
# note: 'helper node': re-positioning for cleaning up canvas
code_block_11 = CodeBlock(list=getItemAtIndex_5) { list; }
# note: cut all WIDTH values in half
code_block_12 = CodeBlock(a=code_block_11) { a/2; }
code_block_13 = CodeBlock { 1; }
shiftIndices = List.ShiftIndices(amount=code_block_13)
# note: rotate all values in list by one position - end comes front, everything else moves down on index
map = List.Map(list=code_block_12, f_x=shiftIndices)
code_block_14 = CodeBlock(x=map) { x; }
code_block_15 = CodeBlock { 0; }
# note: buffer: two mapped noes in a row made the second funtion replace an additional index...the fixes glitch
replaceItemAtIndex = List.ReplaceItemAtIndex(index=code_block_15, item=code_block_15)
# note: replace the first item in each sublist with 0 as starting position for the first point
map_2 = List.Map(list=code_block_14, f_x=replaceItemAtIndex)
integer_slider_spacer = IntegerSlider(10, range=0..100 step 1)
count = Count()
# note: count the number of items in every sublist
map_3 = List.Map(list=code_block_11, f_x=count)
code_block_16 = CodeBlock(n=map_3) { n-1; }
# note: Copy the spacer value as many times as thenumber of items in every sublist
ofRepeatedItem_4 = List.OfRepeatedItem(item=integer_slider_spacer, amount=code_block_16)
code_block_17 = CodeBlock { 0; }
insert = Insert(arg1=code_block_17, arg2=code_block_17)
# note: replace the first item in each sublist with 0 so the spacing occurs after the first instance
map_4 = List.Map(list=ofRepeatedItem_4, f_x=insert)
code_block_18 = CodeBlock(a=code_block_12, b=map_2, c=map_4) { {a,b,c}; }
# note: these transpose functions re-sort the sublists so that the values are grouped by individual width values for each point
transpose_7 = List.Transpose(code_block_18)
# note: sum each width sublist to get total point distance
# note: pair the three lists together:
# 1. half the length values from the first item
# 2. half the length values from the next item
# 3. the space value between points
transpose_8 = List.Transpose()
map_5 = List.Map(list=transpose_7, f_x=transpose_8)
sum = Math.Sum(map_5)
# note: RECURSIVE FUNCTION
# adds each item in the list to the sum of the values before it until the list is exhausted.
# (may need to modify Python within this node)
lunchbox_mass_addition = Custom[LunchBox Mass Addition]()  # Returns the total value of a list of numbers.
map_6 = List.Map(list=sum, f_x=lunchbox_mass_addition.Partials)
# note: collect the largest length value
maximumItem = List.MaximumItem(getItemAtIndex_8)
# note: since 0 is included as an index, need to reduce the list by 1 to maintain the actual number of items
# note: cut all LENGTH values in half
code_block_19 = CodeBlock(a=maximumItem) { a/2; }
flatten_4 = Flatten(code_block_19)
code_block_20 = CodeBlock { 1; }
shiftIndices_2 = List.ShiftIndices(list=flatten_4, amount=code_block_20)
code_block_21 = CodeBlock { 0; }
replaceItemAtIndex_2 = List.ReplaceItemAtIndex(list=shiftIndices_2, index=code_block_21, item=code_block_21)
count_2 = Count(maximumItem)
code_block_22 = CodeBlock(n=count_2) { n-1; }
ofRepeatedItem_5 = List.OfRepeatedItem(item=integer_slider_spacer, amount=code_block_22)
code_block_23 = CodeBlock { 0; }
insert_2 = Insert(ofRepeatedItem_5, code_block_23, code_block_23)
code_block_24 = CodeBlock(a=flatten_4, b=replaceItemAtIndex_2, c=insert_2) { {a,b,c}; }
transpose_9 = List.Transpose(code_block_24)
transpose_10 = List.Transpose()
map_7 = List.Map(list=transpose_9, f_x=transpose_10)
sum_2 = Math.Sum(map_7)
lunchbox_mass_addition_2 = Custom[LunchBox Mass Addition](Numbers=sum_2)

# group: 03_INSTANTIATION: Placing Space Planning Family at centroid coordinates
family_types = FamilyTypes("+Double Door:F (Flush) 72\" x 84\"")
add = Point.Add()
byCoordinates = Point.ByCoordinates(x=map_6)
byCoordinates_2 = Point.ByCoordinates(y=lunchbox_mass_addition_2.Partials)
combine_4 = List.Combine(add, byCoordinates, byCoordinates_2)
levels = Levels("LEVEL 1")
byPointAndLevel = FamilyInstance.ByPointAndLevel(familyType=family_types, point=combine_4, level=levels)

setParameterByName = Element.SetParameterByName()

# group: This group of nodes ccounts for the increase of all columns in the spreadsheet according to the values in the QUANTITY column
ofRepeatedItem_6 = List.OfRepeatedItem()
transpose_11 = List.Transpose(restOfItems)
# note: consolidate all columns from the spreadsheet into one seamless list
flatten_5 = Flatten(transpose_11)
# note: flips data to be grouped by column, not row
transpose_12 = List.Transpose(restOfItems)
code_block_25 = CodeBlock { 4; }
# note: select only items in index 4 (QUANTITY column)
getItemAtIndex_9 = List.GetItemAtIndex(list=transpose_12, index=code_block_25)
# note: counts the total number of columns from the spreadsheet
count_3 = Count(transpose_12)
# note: creates copies of the QUANTITY list based on the total number of columns
ofRepeatedItem_7 = List.OfRepeatedItem(item=getItemAtIndex_9, amount=count_3)
# note: multiplies each column in the spreadsheet by the same number from the QUANTITY column
flatten_6 = Flatten(ofRepeatedItem_7)
combine_5 = List.Combine(ofRepeatedItem_6, flatten_5, flatten_6)
flatten_7 = Flatten(combine_5)
# note: counts the total number of items in each column after recalculating for quantity
count_4 = Count(flatten_2)
# note: breaks the list back into separate sublists based on each column category
chop = List.Chop(flatten_7, count_4)

# group: 01_SORTING: Re-sort all categories from the spreadsheet into sublists accoring to unique DEPARTMENT
code_block_26 = CodeBlock { 2; }
# note: select only items in index 2 (DEPARTMENT column)
getItemAtIndex_10 = List.GetItemAtIndex(list=chop, index=code_block_26)
# note: count all unique departments
countOccurences_2 = Custom[List.CountOccurences](list=getItemAtIndex_10)
chopByLengths = Custom[List.ChopByLengths](lengths=countOccurences_2.Count)  # Turns a list into a list of lists with sublists of varying lengths.
# note: resort each column by the number of items in each unique DEPARTMENT
map_8 = List.Map(list=getItemAtIndex_10, f_x=chopByLengths)

code_block_27 = CodeBlock(x=map_8) { x; }
code_block_28 = CodeBlock { 0; 1; 2; 3; 4; 5; 6; 7; 8; 9; 10; }
# note: these nodes are querying specific sublists in order to populate parameters in the space planning families
list_getitematindex_room_name = List.GetItemAtIndex(list=code_block_27, index=code_block_28.out0)
list_getitematindex_space_type = List.GetItemAtIndex(list=code_block_27, index=code_block_28.out1)
list_getitematindex_width = List.GetItemAtIndex(list=code_block_27, index=code_block_28.out8)
list_getitematindex_length = List.GetItemAtIndex(list=code_block_27, index=code_block_28.out7)
list_getitematindex_height = List.GetItemAtIndex(list=code_block_27, index=code_block_28.out6)
list_getitematindex_total_area = List.GetItemAtIndex(list=code_block_27, index=code_block_28.out5)
list_getitematindex_quantity = List.GetItemAtIndex(list=code_block_27, index=code_block_28.out4)
list_getitematindex_program_area = List.GetItemAtIndex(list=code_block_27, index=code_block_28.out3)
list_getitematindex_department = List.GetItemAtIndex(list=code_block_27, index=code_block_28.out2)
list_getitematindex_notes = List.GetItemAtIndex(list=code_block_27, index=code_block_28.out10)
list_getitematindex_color = List.GetItemAtIndex(list=code_block_27, index=code_block_28.out9)
# note: this list assigns a name to the RGB color values in the Code Block below. These color names also correspond to the colors from the COLOR column in the spreadsheet.
code_block_29 = CodeBlock()
# ---------- code_block_29.designscript (14 lines) ----------
"Gray";
"ShepleyBlue";
"Pink";
"Magenta";
"Purple";
"Lavender";
"Blue";
"Cyan";
"Teal";
"Green";
"Lime";
"Yellow";
"Orange";
"Red";
# ----------------------------------------
create = List.Create(code_block_29.out0, code_block_29.out1, code_block_29.out2, code_block_29.out3, code_block_29.out4, code_block_29.out5, code_block_29.out6, code_block_29.out7, code_block_29.out8, code_block_29.out9, code_block_29.out10, code_block_29.out11, code_block_29.out12, code_block_29.out13)
code_block_30 = CodeBlock()
# ---------- code_block_30.designscript (16 lines) ----------
Gray="_SB_00_Shepley Gray - Space Plan";
ShepleyBlue="_SB_00_Shepley Blue - Space Plan";
Pink="_SB_01_Pink - Space Plan";
Magenta="_SB_02_Magenta - Space Plan";
Purple="_SB_03_Purple - Space Plan";
Lavender="_SB_04_Lavendar - Space Plan";
Blue="_SB_05_Blue - Space Plan";
Cyan="_SB_00_Shepley Gray - Space Plan";
Teal="_SB_00_Shepley Gray - Space Plan";
Green="_SB_00_Shepley Gray - Space Plan";
Lime="_SB_00_Shepley Gray - Space Plan";
Yellow="_SB_00_Shepley Gray - Space Plan";
Orange="_SB_00_Shepley Gray - Space Plan";
Red="_SB_00_Shepley Gray - Space Plan";
colors={Gray, ShepleyBlue, Pink, Magenta, Purple, Lavendar, Blue, Cyan, Teal, Green, Lime, Yellow, Orange, Red};
0..1..#4;
# ----------------------------------------
matchWithKeyValues = Custom[List.MatchWithKeyValues](list=list_getitematindex_color, keys=create, values=code_block_30.colors)  # Matches a list with a given set of keys and returns the values corresponding to the keys
byName = Material.ByName(matchWithKeyValues)
