# Dynamo graph RoomRenumberingBySpline.dyn (Dynamo 0.7.6.4256)

select_model_element = DSModelElementSelection()
curve = CurveElement.Curve(select_model_element)
# note: CASE - ROOM RENUMBERING, Part I
# Created by William Wong, w.wong@case-inc.com
# Released March 13, 2015, for Dynamo v0.7.5
# For more information, visit http://www.case-inc.com/blog/dynamo-renumbering-revit
integer_slider_number_of = IntegerSlider(400, range=0..400 step 1)  # "Integer Slider - NUMBER OF DIVISIONS"
divideEqually = Curve.DivideEqually(curve, integer_slider_number_of)
endPoint = Curve.EndPoint(divideEqually)
categories = Categories("Rooms")
all_elements_of_category = ElementsOfCategory(categories)
watch = Watch(all_elements_of_category)
boundingBox = Geometry.BoundingBox(watch)
contains = BoundingBox.Contains(boundingBox)
map = List.Map(endPoint, contains)
filterByBoolMask = List.FilterByBoolMask(watch)
map_2 = List.Map(map, filterByBoolMask)
flatten = Flatten(map_2)
uniqueItems = List.UniqueItems(flatten)
watch_reordered_rooms = Watch(uniqueItems)
string = StringInput("Number")
number = DoubleInput(100)
count = Count(watch_reordered_rooms)
number_2 = DoubleInput(1)
number_sequence = NumberSeq(number, count, number_2, lacing=Longest)
string_from_object = FromObject(number_sequence)
setParameterByName = Element.SetParameterByName(watch_reordered_rooms, string, string_from_object)
