# Dynamo graph Shapefile to Dynamo - Contours.dyn (Dynamo 0.9.0.3067)

file_path = Filename("\\bcj.loc\02_PG\Projects\2015\15202_390 Elliott Road\2 Process\2.1 Site Info\1A Site Survey\Preliminary Info\AlleghenyCounty_Contours2006\Site_Contours.shp")
shapefile_geometry = Python(IN[0]=file_path)
# ---------- shapefile_geometry.python (49 lines) ----------
import clr
import sys

pyt_path = r'C:\Program Files (x86)\IronPython 2.7\Lib'
sys.path.append(pyt_path)

import os
import shapefile

clr.AddReference('ProtoGeometry')
from Autodesk.DesignScript.Geometry import *

#Link Path to the .shp file
dataEnteringNode = IN

#Define Outputs
output = []
numShapes = []
attributes = []
points = []
#pcurves = []
#ncurves = []

#Load the .shp file into the Shapefile Reader for other uses
sf = shapefile.Reader(IN[0])

#Return as list of Shape objects describing the geometry of each shape record
shapes = sf.shapes()
iter = list(sf.iterShapes())

#Calculate the number of shapes in the shapefile and append to the Output variable
numShapes = len(shapes)
output.append(numShapes)

#Return the attributes assigned to each shapes
for i in dir(shapes[0]):
	if not i.startswith('__'):
		attributes.append(i)
output.append(attributes)

#Return the points for each shape in the file
ipnts = []
for i in iter:
	ipnts.append(i.points)
points.append(ipnts)
output.append(points)

#Assign your output to the OUT variable.
OUT = output
# ----------------------------------------
code_block = CodeBlock { 1; }
getItemAtIndex = List.GetItemAtIndex(list=shapefile_geometry, index=code_block)
shapefile_data = Python(IN[0]=file_path)
# ---------- shapefile_data.python (35 lines) ----------
import clr
import sys

pyt_path = r'C:\Program Files (x86)\IronPython 2.7\Lib'
sys.path.append(pyt_path)

import os
import shapefile

clr.AddReference('ProtoGeometry')
from Autodesk.DesignScript.Geometry import *

#Link Path to the .shp file
dataEnteringNode = IN[0]
field_query = IN[1]

#Define Outputs
output = []
fields = []
records = []

#Load the .shp file into the Shapefile Reader for other uses
sf = shapefile.Reader(IN[0])

#Return the fields assigned to each shapefil
rawfields = sf.fields
fields = [item[0] for item in rawfields]
output.append(fields)

#Return the points for each shape in the file
records.append(sf.records())
output.append(records)

#Assign your output to the OUT variable.
OUT = output
# ----------------------------------------
code_block_2 = CodeBlock { 1; }
getItemAtIndex_2 = List.GetItemAtIndex(list=shapefile_data, index=code_block_2)
code_block_3 = CodeBlock { 1; }
flatten = List.Flatten(list=getItemAtIndex_2, amt=code_block_3)
python_script = Python(IN[0]=flatten)
# ---------- python_script.python (8 lines) ----------
import clr
clr.AddReference('ProtoGeometry')
from Autodesk.DesignScript.Geometry import *
#The inputs to this node will be stored as a list in the IN variables.
dataEnteringNode = IN

#Assign your output to the OUT variable.
OUT = [item[3] for item in IN[0]]
# ----------------------------------------
count = Count(python_script)
file_path_2 = Filename("P:\2015\15202_390 Elliott Road\2 Process\2.1 Site Info\1A Site Survey\Preliminary Info\151221 Site Topo Points")
code_block_4 = CodeBlock { 2; }
getItemAtIndex_3 = List.GetItemAtIndex(list=shapefile_geometry, index=code_block_4)
code_block_5 = CodeBlock { 1; }
flatten_2 = List.Flatten(list=getItemAtIndex_3, amt=code_block_5)
python_script_2 = Python(IN[0]=flatten_2)
# ---------- python_script_2.python (12 lines) ----------
import clr
clr.AddReference('ProtoGeometry')
from Autodesk.DesignScript.Geometry import *
#The inputs to this node will be stored as a list in the IN variables.
dataEnteringNode = IN

coords = []

for item in IN[0]:
	coords.append(zip(*item))
#Assign your output to the OUT variable.
OUT = coords
# ----------------------------------------
code_block_6 = CodeBlock { 0; 1; }
getItemAtIndex_4 = List.GetItemAtIndex(index=code_block_6.out0)
map = List.Map(list=python_script_2, f_x=getItemAtIndex_4)
getItemAtIndex_5 = List.GetItemAtIndex(index=code_block_6.out1)
map_2 = List.Map(list=python_script_2, f_x=getItemAtIndex_5)
cycle = List.Cycle()
count_2 = Count()
map_3 = List.Map(list=map, f_x=count_2)
combine = List.Combine(cycle, python_script, map_3)
byCoordinates = Point.ByCoordinates(x=map, y=map_2, z=combine)
flatten_3 = Flatten(byCoordinates)
deconstructPoint = Geometry.Points.DeconstructPoint(flatten_3)
create = List.Create(deconstructPoint.out0, deconstructPoint.out1, deconstructPoint.out2)
transpose = List.Transpose(create)
writeToFile = CSV.WriteToFile(file_path_2, transpose)
