# Dynamo graph Update View Instance Param for Issued Sheets.dyn (Dynamo 0.8.2.2392)

# note: BCJdt
# Jon Szczesniak
# jszczesniak@bcj.com
# 2015 10 19
# OBJECTIVE:
# Update an instance parameter for a view based on whether the sheet the view is place on is being issued. Then create a filter based on this instance parameter to turn *off* the visibility of views *not* being issued with this set.
# EXPLANATION:
# This workflow will query all the sheets in your project for the value of a given parameter. The default parameter it queries is "Sheet Issued-DD". This parameter is project specific, but is the parameter that is typically used to populate the sheet index.
# If the sheet *is* being issued the workflow will then parse all the views on the issued sheets, and update an instance parameter called "IsViewIssued" for each specific view.
# The last step occurs outside of dynamo. You will need to create a filter that searches the "IsViewIssued" parameter for values that are false. You can then turn off the visibility of these views.

categories = Categories("Sheets")
all_elements_of_category = ElementsOfCategory(categories)

# group: What is the name of the Sheet Issuance Parameter you are matching the sheets against?
code_block = CodeBlock { "Sheet Issued-DD"; }

getParameterValueByName = Element.GetParameterValueByName(element=all_elements_of_category, parameterName=code_block)
code_block_2 = CodeBlock { "●"; }
eq = getParameterValueByName == code_block_2
filterByBoolMask = List.FilterByBoolMask(list=all_elements_of_category, mask=eq)
views = Sheet.Views(filterByBoolMask.in)
flatten = Flatten(views)
code_block_3 = CodeBlock { true; }
clean = List.Clean(list=flatten, preserveIndices=code_block_3)
isNull = Object.IsNull(clean)
code_block_4 = CodeBlock { true; }
allIndicesOf = List.AllIndicesOf(list=isNull, item=code_block_4)
removeItemAtIndex = List.RemoveItemAtIndex(list=clean, indices=allIndicesOf)

# group: Verify that you have an instance parameter called "IsViewIssued". It should be a text parameter set to View Categories.
code_block_5 = CodeBlock { "IsViewIssued"; true; }

setParameterByName = Element.SetParameterByName(element=removeItemAtIndex, parameterName=code_block_5.out0, value=code_block_5.out1)
